# Grasshopper definition Mahavir's inputs.gh (Grasshopper 0.9.76)
# plug-ins: Firefly.Core

ports_available = COMPortsAvailable()
panel = Panel(ports_available)
open_port = OpenClosePort(OpenClosePort=Toggle(False), PortNumber=panel, BaudRate=115200)
panel_2 = Panel(open_port)
uno_write = UnoWrite(
    StartWritingValues=Toggle(False),
    DigitalPin13=0,
    DigitalPin12=0,
    DigitalPin11=0,
    DigitalPin10=0,
    DigitalPin9=0,
    DigitalPin8=0,
    DigitalPin6=0,
    DigitalPin5=0,
    DigitalPin3=0,
    PortNumber=panel)  # -> ArduinoOutput, StatusMessage
panel_3 = Panel(uno_write.StatusMessage)
panel_4 = Panel(uno_write.ArduinoOutput)
